# Grasshopper definition WeaverNestFinal.gh (Grasshopper 1.0.7)
# plug-ins: Weaverbird

# ----
# Nest Body Shape
number_slider = Slider(0, range=-40..40)
pt = ConstructPoint(XCoordinate=number_slider, YCoordinate=Slider(0, range=-40..40), ZCoordinate=Slider(0, range=-40..40))
number_slider_2 = Slider(17, range=3..60)
line = LineSDL(Start=pt, Direction=Vector(0, 0, 1), Length=Slider(373, range=50..1000))
range = Range(Domain=Domain(0, 1), Steps=number_slider_2)
divide = DivideCurve(Curve=line, Count=number_slider_2, Kinks=False)  # -> Points, Tangents, Parameters
graph = GraphMapper(
    range,
    x0=0,
    x1=1,
    y0=0,
    y1=1,
    container_name="Bezier",
    cpx=[0, 0.2826086879, 0.4432404041, 1],
    cpy=[0.09420287609, 0.2318840623, 0.04773390293, 0.009487450123])
expression = Expression(x=graph, y=Slider(621, range=200..1000), Expression="x * y")
circle = CircleCNR(Center=divide.Points, Normal=Vector(0, 0, 1), Radius=expression)
area = Area(Geometry=circle)  # -> Area, Centroid
series = Series(Start=0, Step=Slider(0.538, range=0..10), Count=number_slider_2)
rotate = Rotate(Geometry=circle, Angle=series, Plane=area.Centroid)  # -> Geometry, Transform
seam = Seam(Curve=rotate.Geometry, Seam=expression)
loft = Loft(Curves=seam, Options={Adjust=False, Closed=False, LoftEnds=0, LoftSimp=0, LoftType=0, Rebuild=10, Refit=0.01})

# ----
# Tunnel Entrance Tube
number_slider_3 = Slider(0, range=-200..200)
pt_2 = ConstructPoint(XCoordinate=Slider(15, range=-200..200), YCoordinate=number_slider_3, ZCoordinate=Slider(37, range=-200..200))
yz = YZPlane(Origin=pt_2)
cir = Circle(Plane=yz, Radius=Slider(45, range=2..400))
xz = XZPlane(Origin=Point(0, 0, 0))
rotate_2 = Rotate(Geometry=cir, Angle=Slider(-1.34, range=-1.57..0), Plane=xz)  # -> Geometry, Transform
Z = UnitZ(Factor=Slider(-200, range=-200..200))
extr = Extrude(Base=rotate_2.Geometry, Direction=Z)

# ----
# Cylinder Brep for Entrance Hole
number_slider_4 = Slider(158, range=-200..200)
pt_3 = ConstructPoint(XCoordinate=number_slider_4, YCoordinate=Slider(0, range=-200..200), ZCoordinate=Slider(88, range=-200..200))
yz_2 = YZPlane(Origin=pt_3)
number_slider_5 = Slider(0.36, range=-1.57..1.57)
cir_2 = Circle(Plane=yz_2, Radius=Slider(49, range=10..200))
xz_2 = XZPlane(Origin=Point(0, 0, 0))
X = UnitX(Factor=Slider(-73, range=-200..0))
rotate_3 = Rotate(Geometry=cir_2, Angle=number_slider_5, Plane=xz_2)  # -> Geometry, Transform
rotate_4 = Rotate(Geometry=X, Angle=number_slider_5, Plane=xz_2)  # -> Geometry, Transform
extr_2 = Extrude(Base=rotate_3.Geometry, Direction=rotate_4.Geometry)
cap = CapHoles(Brep=extr_2)

# ----
# Cut Entrance Hole
# Convert to Mesh
number_slider_6 = Slider(32, range=0..100)
bbx = BrepBrep(BrepA=loft, BrepB=cap)  # -> Curves, Points
srfsplit = SurfaceSplit(Surface=loft, Curves=bbx.Curves)
item = ListItem(List=srfsplit, Index=0, Wrap=True)
custom_mesh_settings = SettingsCustom(
    StitchSeams=True,
    SimplePlanes=False,
    Refine=True,
    MinCount=Slider(49, range=0..500),
    MaxCount=Slider(408, range=50..500),
    AspectRatio=20,
    MaxDistance=0,
    MaxAngle=number_slider_6,
    MinEdge=0,
    MaxEdge=0)
cap_2 = CapHoles(Brep=item)
mesh = MeshBrep(Brep=cap_2, Settings=custom_mesh_settings)

# ----
# Weaver Bird Base Plate
cap_3 = CapHoles(Brep=loft)
debrep = DeconstructBrep(Brep=cap_3)  # -> Faces, Edges, Vertices
number_slider_7 = Slider(8, range=0..10)
srf = Surface(debrep.Faces)
neg = Negative(Value=number_slider_7)
item_2 = ListItem(List=srf, Index=2, Wrap=True)
Z_2 = UnitZ(Factor=number_slider_7)
item_3 = ListItem(List=srf, Index=1, Wrap=True)
Z_3 = UnitZ(Factor=neg)
extr_3 = Extrude(Base=item_2, Direction=Z_2)
extr_4 = Extrude(Base=item_3, Direction=Z_3)
mesh_2 = MeshBrep(
    Brep=[extr_3, extr_4],
    Settings={GridMaxCount=0, GridMinCount=16, JaggedSeams=False, MaxEdgeLength=0, MinEdgeLength=0.0001, MinTolerance=0, Refine=True, RefineAngle=0, RelativeTolerance=0.65, SimplePlanes=True, Tolerance=0})

# ----
# Weaver Bird Mesh Formation
number_slider_8 = Slider(15, range=0..100)
wbframe = WeaverbirdsPictureFrame(MeshPolylines=mesh, Distance=number_slider_8, InsetType=0)  # -> flatten(OutMesh)
mjoin = MeshJoin(Meshes=wbframe)

# ----
# Final Weaver Bird Smoothing
number_slider_9 = Slider(8, range=0..15)
wbthicken = WeaverbirdsMeshThicken(MeshCurves=mjoin, Distance=number_slider_9, OffsetType=0)
mjoin_2 = MeshJoin(Meshes=flatten([mesh_2, wbthicken]))
wbcatmullclark = WeaverbirdsCatmullClarkSubdivision(MeshCurves=mjoin_2, Level=Slider(5, range=0..10), SmoothNakedEdges=1)

# ----
# Voronoi Mesh Pattern
srf_2 = Surface(loft)
c_scripting = CSharpScript(surface=srf_2)  # -> out, A; inputs surface: Surface; disabled
# ---------- c_scripting: C# ----------
surface.surface.
# ---------- end c_scripting ----------
dim = Dimensions(Surface=srf_2)  # -> UDimension, VDimension
planesrf = PlaneSurface(Plane=PlaneXY(0, 0, 0), XSize=dim.UDimension, YSize=dim.VDimension)
srf_3 = Surface(srf_2)
popgeo = PopulateGeometry(Geometry=planesrf, Count=Slider(295, range=0..1000), Seed=Slider(41, range=0..100))
crv = Curve(planesrf)
voronoi = Voronoi(Points=popgeo, Boundary=crv, BruteForceOverride=False)
# Why does the scaling get weird when the circle is in the voronoi pattern?
number_slider_10 = Slider(0.6, range=0..1)
srf_4 = Surface(srf_3)
Z_4 = UnitZ(Factor=Slider(10, range=0..25))
number_slider_11 = Slider(1, range=0..1)

# ----
# Cut Hole from Voronoi Surface
number_slider_12 = Slider(100, range=0..100)
pt_4 = Point(<point referenced from the Rhino model>)
circle_2 = CircleCNR(Center=pt_4, Normal=Vector(0, 0, 1), Radius=number_slider_12)
trim = TrimWithRegion(Curve=voronoi, Region=circle_2)  # -> Inside, simplify(Outside)
crv_2 = Curve(simplify(flatten([circle_2, trim.Outside])))

scale = Scale(Geometry=crv_2, Center=popgeo, Factor=number_slider_10)  # -> Geometry, Transform
crv_3 = Curve(flatten([crv, scale.Geometry]))
boundary = BoundarySurfaces(Edges=crv_3)
extr_5 = Extrude(Base=boundary, Direction=Z_4)
box = Box(extr_5)
srfmorph = SurfaceMorph(
    Geometry=extr_5,
    Reference=box,
    Surface=reparameterize(srf_4),
    UDomain=number_slider_11,
    VDomain=number_slider_11,
    WDomain=Slider(4.393, range=0..10))
preview = CustomPreview(
    Geometry=srfmorph,
    Material={diffuse=RGB(228, 178, 227), emission=RGB(68, 53, 68), shine=0.5, specular=RGB(255, 254, 254), transparency=0})
